# Grasshopper definition add_extend.gh (Grasshopper 1.0.7)

pt = Point(<point referenced from the Rhino model>)
pt_2 = Point(<point referenced from the Rhino model>)
pt_3 = Point(<point referenced from the Rhino model>)
pt_4 = Point(<point referenced from the Rhino model>)
merge = Merge(Data1=pt, Data2=pt_4, Data3=pt_3, Data4=pt_2, Data5=pt)
pline = PolyLine(Vertices=merge, Closed=False)
pt_5 = Point(pt_2)
pt_6 = Point(pt_3)
pt_7 = Point(pt)
pt_8 = Point(pt_4)
Z = UnitZ(Factor=Slider(20, range=0..20))
Z_2 = UnitZ(Factor=Slider(20, range=0..20))
move = Move(Geometry=pt_7, Motion=Z)  # -> Geometry, Transform
move_2 = Move(Geometry=pt_8, Motion=Z)  # -> Geometry, Transform
move_3 = Move(Geometry=pt_6, Motion=Z_2)  # -> Geometry, Transform
move_4 = Move(Geometry=pt_5, Motion=Z_2)  # -> Geometry, Transform
Z_3 = UnitZ(Factor=Slider(10, range=-20..10))
Z_4 = UnitZ(Factor=Slider(10, range=-20..10))
move_5 = Move(Geometry=move.Geometry, Motion=Z_3)  # -> Geometry, Transform
move_6 = Move(Geometry=move_2.Geometry, Motion=Z_4)  # -> Geometry, Transform
move_7 = Move(Geometry=move_3.Geometry, Motion=Z_4)  # -> Geometry, Transform
move_8 = Move(Geometry=move_4.Geometry, Motion=Z_3)  # -> Geometry, Transform
move_9 = Move(Geometry=[move_5.Geometry, move_8.Geometry], Motion=Vector(0, 0, 10))  # -> graft(Geometry), Transform
move_10 = Move(Geometry=[move_5.Geometry, move_6.Geometry], Motion=Vector(0, 0, 10))  # -> graft(Geometry), Transform
move_11 = Move(Geometry=[move_6.Geometry, move_7.Geometry], Motion=Vector(0, 0, 10))  # -> graft(Geometry), Transform
move_12 = Move(Geometry=[move_7.Geometry, move_8.Geometry], Motion=Vector(0, 0, 10))  # -> graft(Geometry), Transform
bang = ExplodeTree(Data=move_9.Geometry)  # -> flatten(Branch0), Branch1
bang_2 = ExplodeTree(Data=move_10.Geometry)  # -> Branch0, flatten(Branch1)
bang_3 = ExplodeTree(Data=move_11.Geometry)  # -> Branch0, flatten(Branch1)
bang_4 = ExplodeTree(Data=move_12.Geometry)  # -> Branch0, flatten(Branch1)
ln = Line(StartPoint=bang_2.Branch0, EndPoint=bang_2.Branch1)
ln_2 = Line(StartPoint=bang_4.Branch0, EndPoint=bang_4.Branch1)
ln_3 = Line(StartPoint=bang.Branch0, EndPoint=bang.Branch1)
ln_4 = Line(StartPoint=bang_3.Branch0, EndPoint=bang_3.Branch1)
pline_2 = PolyLine(Vertices=[bang.Branch0, bang_2.Branch1, bang_3.Branch1, bang_4.Branch1], Closed=True)
crv = Curve(pline_2)
crv_2 = Curve(pline)
loft = Loft(Curves=[crv, crv_2], Options={Adjust=False, Closed=False, LoftEnds=0, LoftSimp=0, LoftType=0, Rebuild=10, Refit=0.01})
