# Grasshopper definition add_inflate.gh (Grasshopper 1.0.7)

explode = Explode(Recursive=True)  # -> Segments, Vertices
pt = Point(graft(explode.Vertices))
bang = ExplodeTree(Data=pt)  # -> Branch0, Branch1, Branch2, Branch3, Branch4
pt_2 = Point(flatten(bang.Branch0))
pt_3 = Point(flatten(bang.Branch1))
pt_4 = Point(flatten(bang.Branch2))
pt_5 = Point(flatten(bang.Branch3))
ln = Line(StartPoint=pt_2, EndPoint=pt_3)
ln_2 = Line(StartPoint=pt_3, EndPoint=pt_4)
ln_3 = Line(StartPoint=pt_4, EndPoint=pt_5)
ln_4 = Line(StartPoint=pt_5, EndPoint=pt_2)
divide = DivideCurve(Curve=ln, Count=2, Kinks=False)  # -> Points, Tangents, Parameters
divide_2 = DivideCurve(Curve=ln_2, Count=2, Kinks=False)  # -> Points, Tangents, Parameters
divide_3 = DivideCurve(Curve=ln_3, Count=2, Kinks=False)  # -> Points, Tangents, Parameters
divide_4 = DivideCurve(Curve=ln_4, Count=2, Kinks=False)  # -> Points, Tangents, Parameters
item = ListItem(List=divide.Points, Index=1, Wrap=True)
item_2 = ListItem(List=divide_2.Points, Index=1, Wrap=True)
item_3 = ListItem(List=divide_3.Points, Index=1, Wrap=True)
item_4 = ListItem(List=divide_4.Points, Index=1, Wrap=True)
Z = UnitZ(Factor=Slider(17, range=0..20))
move = Move(Geometry=item, Motion=Z)  # -> Geometry, Transform
move_2 = Move(Geometry=item_3, Motion=Z)  # -> Geometry, Transform
pt_6 = Point(flatten(move.Geometry))
pt_7 = Point()
pt_8 = Point(flatten(move_2.Geometry))
pt_9 = Point()
pt_10 = Point(pt_5)
pt_11 = Point(pt_2)
pt_12 = Point(pt_3)
pt_13 = Point(pt_4)
pline = PolyLine(Vertices=[pt_11, pt_6, pt_10, pt_8], Closed=True)
pline_2 = PolyLine(Vertices=[pt_6, pt_13, pt_12, pt_8], Closed=True)
pline_3 = PolyLine(Vertices=[pt_11, pt_6, pt_10, pt_13, pt_12, pt_8], Closed=True)
crv = Curve(pline_3)
