# Grasshopper definition building_generator_version2.gh (Grasshopper 1.0.7)

# ---- group: Transformation rules
ground_floor_rotate_angle = Slider(0, range=-2..2)
ground_floor_scale_factor = Slider(1, range=0.5..1.5)
roof_rotate_angle = Slider(0, range=-2..2)
roof_scale_factor = Slider(1, range=0.5..1.5)

# ---- group: Genes
building_storey = Slider(30, range=20..30)
floor_height = Slider(4.9, range=4..6)
ground_floor_geometry = Curve(<curve referenced from the Rhino model>)

# ---- group: Gorund floor center point
ground_floor_geometry_2 = Curve(ground_floor_geometry)
topoly = CurveToPolyline(Curve=ground_floor_geometry_2, ToleranceDistance=0, ToleranceAngle=0)  # -> Polyline, Segments
pcen = PolygonCenter(Polyline=topoly.Polyline)  # -> CenterV, CenterE, CenterA
gf_center_point = Point(pcen.CenterV)

# ---- group: Building height
building_storey_2 = Number(building_storey)
floor_height_2 = Number(floor_height)
multiplication = Multiplication(BuildingStorey=building_storey_2, FloorHeight=floor_height_2)
building_height = Number(multiplication)
panel = Panel(building_height)

# ---- group: Ground floor geometry scale
gf_center_point_2 = Point(gf_center_point)
ground_floor_scale_factor_2 = Number(ground_floor_scale_factor)
gf_geometry = Curve(ground_floor_geometry)
scale = Scale(Geometry=gf_geometry, Center=gf_center_point_2, Factor=ground_floor_scale_factor_2)  # -> Geometry, Transform

# ---- group: Roof center point
building_height_2 = Number(panel)
gf_center_point_3 = Point(gf_center_point)
Z = UnitZ(Factor=building_height_2)
move = Move(Geometry=gf_center_point_3, Motion=Z)  # -> Geometry, Transform

# ---- group: Roof geometry
building_height_3 = Number(panel)
ground_floor_geometry_3 = Curve(ground_floor_geometry)
Z_2 = UnitZ(Factor=building_height_3)
move_2 = Move(Geometry=ground_floor_geometry_3, Motion=Z_2)  # -> Geometry, Transform

# ---- group: Roof geometry scale
roof_center_point = Point(move.Geometry)
roof_scale_factor_2 = Number(roof_scale_factor)
roof_geometry = Curve(move_2.Geometry)
scale_2 = Scale(Geometry=roof_geometry, Center=roof_center_point, Factor=roof_scale_factor_2)  # -> Geometry, Transform

# ---- group: Roof geometry rotate
roof_rotate_angle_2 = Number(roof_rotate_angle)
roof_plane = Plane(move.Geometry)
rotate = Rotate(Geometry=scale_2.Geometry, Angle=roof_rotate_angle_2, Plane=roof_plane)  # -> Geometry, Transform

# ---- group: Ground floor geometry rotate
gf_center_point_4 = Point(gf_center_point)
gf_rotate_angle = Number(ground_floor_rotate_angle)
rotate_2 = Rotate(Geometry=scale.Geometry, Angle=gf_rotate_angle, Plane=gf_center_point_4)  # -> Geometry, Transform

# ----
roof_rotate_angle_3 = Slider(0, range=-1..1)
roof_rotate_angle_4 = Slider(0, range=-0.5..0.5)
yz = YZPlane(Origin=move.Geometry)
rotate_3 = Rotate(Geometry=rotate.Geometry, Angle=roof_rotate_angle_3, Plane=yz)  # -> Geometry, Transform
xz = XZPlane(Origin=Point(0, 0, 0))
rotate_4 = Rotate(Geometry=rotate_3.Geometry, Angle=roof_rotate_angle_4, Plane=xz)  # -> Geometry, Transform

# ---- group: Building mass
ground_floor = Curve(rotate_2.Geometry)
roof = Curve(rotate_4.Geometry)
loft = Loft(
    Curves=[roof, ground_floor],
    Options={Adjust=False, Closed=False, LoftEnds=0, LoftSimp=0, LoftType=0, Rebuild=10, Refit=0.01})
cap = CapHoles(Brep=loft)
preview = CustomPreview(Geometry=cap, Material=ColourSwatch(SwatchColor=RGB(176, 255, 229)))

# ---- group: Ground floor area
ground_floor_geometry_4 = Curve(ground_floor_geometry)
area = Area(Geometry=ground_floor_geometry_4)  # -> BuildingArea, Centroid

# ----
building_area = Number(area.BuildingArea)

# ---- group: Ground floor area (continued)
panel_2 = Panel(building_area)

# ---- group: Floors
building_mass = Brep(cap)
floor_height_3 = Number(floor_height)
contour = Contour(Shape=building_mass, Point=Point(0, 0, 0), Direction=Vector(0, 0, 1), Distance=floor_height_3)  # -> flatten(Contours)
area_2 = Area(Geometry=contour)  # -> Area, Centroid
ma = MassAddition(Input=area_2.Area)  # -> Result, PartialResults
panel_3 = Panel(area_2.Area)

# ----
total_area = Number(ma.Result)
total_area_2 = Number(total_area)
int = Integer(total_area_2)
panel_4 = Panel(int)

# ---- group: Floors (continued)
panel_5 = Panel(total_area)
