# Grasshopper definition env_creator.gh (Grasshopper 1.0.7)

swatch = ColourSwatch(SwatchColor=RGB(255, 241, 219))

# ---- group: Grass
crv = Curve(<curve referenced from the Rhino model>)
srf = Surface(crv)
preview = CustomPreview(Geometry=srf, Material=ColourSwatch(SwatchColor=RGB(221, 255, 214)))

# ---- group: Road
crv_2 = Curve(<curve referenced from the Rhino model>)
crv_3 = Curve([<curve referenced from the Rhino model> x3])
srf_2 = Surface(crv_2)
srf_3 = Surface(crv_3)
rdiff = RegionDifference(CurvesA=srf_2, CurvesB=srf_3)
boundary = BoundarySurfaces(Edges=rdiff)
Z = UnitZ(Factor=0.1)
move = Move(Geometry=boundary, Motion=Z)  # -> Geometry, Transform
preview_2 = CustomPreview(Geometry=move.Geometry, Material=ColourSwatch(SwatchColor=RGB(140, 140, 140)))

# ---- group: Building_1
crv_4 = Curve([<curve referenced from the Rhino model> x60])
Z_2 = UnitZ(Factor=4)
srf_4 = Surface(crv_4)
extr = Extrude(Base=srf_4, Direction=Z_2)
preview_3 = CustomPreview(Geometry=extr, Material=swatch)

# ---- group: Building_2
crv_5 = Curve([<curve referenced from the Rhino model> x8])
Z_3 = UnitZ(Factor=12)
srf_5 = Surface(crv_5)
extr_2 = Extrude(Base=srf_5, Direction=Z_3)
preview_4 = CustomPreview(Geometry=extr_2, Material=swatch)

# ---- group: Building_3
crv_6 = Curve([<curve referenced from the Rhino model> x2])
Z_4 = UnitZ(Factor=80)
srf_6 = Surface(crv_6)
extr_3 = Extrude(Base=srf_6, Direction=Z_4)
preview_5 = CustomPreview(Geometry=extr_3, Material=ColourSwatch(SwatchColor=RGB(168, 226, 255)))
