# Grasshopper definition form_generator.gh (Grasshopper 1.0.7)

# ---- group: Block
material = CreateMaterial(
    Diffuse=ColourSwatch(SwatchColor=RGB(230, 230, 230)),
    Specular=RGB(255, 255, 255),
    Emission=RGB(0, 0, 0),
    Transparency="0.4",
    Shine=0)

# ---- group: Block / Road
crv = Curve(<curve referenced from the Rhino model>)
crv_2 = Curve([<curve referenced from the Rhino model> x3])
srf = Surface(crv)
srf_2 = Surface(crv_2)
rdiff = RegionDifference(CurvesA=srf, CurvesB=srf_2)
boundary = BoundarySurfaces(Edges=rdiff)
Z = UnitZ(Factor=0.1)
move = Move(Geometry=boundary, Motion=Z)  # -> Geometry, Transform
preview = CustomPreview(Geometry=move.Geometry, Material=ColourSwatch(SwatchColor=RGB(140, 140, 140)))

# ---- group: Block / Building_1
crv_3 = Curve([<curve referenced from the Rhino model> x57])
Z_2 = UnitZ(Factor=4)
srf_3 = Surface(crv_3)
extr = Extrude(Base=srf_3, Direction=Z_2)
preview_2 = CustomPreview(Geometry=extr, Material=material)

# ---- group: Block / Building_2
crv_4 = Curve([<curve referenced from the Rhino model> x8])
Z_3 = UnitZ(Factor=12)
srf_4 = Surface(crv_4)
extr_2 = Extrude(Base=srf_4, Direction=Z_3)
preview_3 = CustomPreview(Geometry=extr_2, Material=material)

# ---- group: Block / Building_3
crv_5 = Curve(<curve referenced from the Rhino model>)
Z_4 = UnitZ(Factor=70)
srf_5 = Surface(crv_5)
extr_3 = Extrude(Base=srf_5, Direction=Z_4)
preview_4 = CustomPreview(Geometry=extr_3, Material=material)

# ---- group: Block / Grass
crv_6 = Curve(<curve referenced from the Rhino model>)
srf_6 = Surface(crv_6)
preview_5 = CustomPreview(Geometry=srf_6, Material=ColourSwatch(SwatchColor=RGB(221, 255, 214)))

# ---- group: Block / Site
crv_7 = Curve(<curve referenced from the Rhino model>)
area = Area(Geometry=crv_7)  # -> Area, Centroid
expression = Expression(x=area.Area, Expression="Format(\"{0:0.00}\",x)")

# ----
galapagos = Galapagos(fitness=num)
site_area_sqm = Panel(expression)

# ---- group: Basic
floor_height = Slider(4, range=4..6)
building_storey = Slider(20, range=15..25)

# ---- group: Ground Geometry
crv_8 = Curve(<curve referenced from the Rhino model>)

# ---- group: Ground Geometry Rotation
ground_geometry_rotation = Slider(0, range=-1..1)
pi = Pi(Factor=1)
area_2 = Area(Geometry=crv_8)  # -> Area, Centroid
multiplication = Multiplication(A=ground_geometry_rotation, B=pi)
rotate = Rotate(Geometry=crv_8, Angle=multiplication, Plane=area_2.Centroid)  # -> Geometry, Transform

# ---- group: Line
north_horz = Slider(0, range=-10..10)
north_vert = Slider(0, range=-10..10)
south_horz = Slider(0, range=-10..10)
south_vert = Slider(0, range=-10..10)
west_horz = Slider(0, range=-10..10)
west_vert = Slider(0, range=-10..10)
east_horz = Slider(0, range=-10..10)
east_vert = Slider(0, range=-10..10)

# ---- group: Point
vec = VectorXYZ(XComponent=Slider(0, range=-10..10), YComponent=Slider(0, range=-10..10), ZComponent=Slider(0, range=-20..20))  # -> Vector, Length
vec_2 = VectorXYZ(XComponent=Slider(0, range=-10..10), YComponent=Slider(0, range=-10..10), ZComponent=Slider(0, range=-20..20))  # -> Vector, Length
vec_3 = VectorXYZ(XComponent=Slider(0, range=-10..10), YComponent=Slider(0, range=-10..10), ZComponent=Slider(0, range=-20..20))  # -> Vector, Length
vec_4 = VectorXYZ(XComponent=Slider(0, range=-10..10), YComponent=Slider(0, range=-10..10), ZComponent=Slider(0, range=-20..20))  # -> Vector, Length

# ---- group: Explode Ground Geometry
explode = Explode(Curve=rotate.Geometry, Recursive=True)  # -> Segments, Vertices
pt = Point(graft(explode.Vertices))
bang = ExplodeTree(Data=pt)  # -> Branch0, Branch1, Branch2, Branch3, Branch4

# ---- group: Ground geometry line translation
south_horz_2 = Slider(0, range=-5..5)
north_horz_2 = Slider(0, range=-5..5)
Y = UnitY(Factor=south_horz_2)
Y_2 = UnitY(Factor=north_horz_2)
pt_2 = Point(bang.Branch3)
pt_3 = Point(bang.Branch1)
pt_4 = Point(bang.Branch2)
pt_5 = Point(bang.Branch0)
move_2 = Move(Geometry=pt_5, Motion=Y_2)  # -> Geometry, Transform
move_3 = Move(Geometry=pt_3, Motion=Y_2)  # -> Geometry, Transform
move_4 = Move(Geometry=pt_4, Motion=Y)  # -> Geometry, Transform
move_5 = Move(Geometry=pt_2, Motion=Y)  # -> Geometry, Transform
east_horz_2 = Slider(0, range=-5..10)
west_horz_2 = Slider(0, range=-10..10)
X = UnitX(Factor=east_horz_2)
X_2 = UnitX(Factor=west_horz_2)
move_6 = Move(Geometry=move_2.Geometry, Motion=X_2)  # -> Geometry, Transform
move_7 = Move(Geometry=move_3.Geometry, Motion=X)  # -> Geometry, Transform
move_8 = Move(Geometry=move_4.Geometry, Motion=X)  # -> Geometry, Transform
move_9 = Move(Geometry=move_5.Geometry, Motion=X_2)  # -> Geometry, Transform
Z_5 = UnitZ(Factor=0)
move_10 = Move(Geometry=[move_6.Geometry, move_9.Geometry], Motion=Z_5)  # -> graft(Geometry), Transform
move_11 = Move(Geometry=[move_6.Geometry, move_7.Geometry], Motion=Z_5)  # -> graft(Geometry), Transform
move_12 = Move(Geometry=[move_7.Geometry, move_8.Geometry], Motion=Z_5)  # -> graft(Geometry), Transform
move_13 = Move(Geometry=[move_8.Geometry, move_9.Geometry], Motion=Z_5)  # -> graft(Geometry), Transform
bang_2 = ExplodeTree(Data=move_10.Geometry)  # -> flatten(_0000), _0030
bang_3 = ExplodeTree(Data=move_11.Geometry)  # -> _0000, flatten(_0010)
bang_4 = ExplodeTree(Data=move_12.Geometry)  # -> _0010, flatten(_0020)
bang_5 = ExplodeTree(Data=move_13.Geometry)  # -> _0020, flatten(_0030)
pline = PolyLine(Vertices=[bang_2._0000, bang_3._0010, bang_4._0020, bang_5._0030], Closed=True)
crv_9 = Curve(pline)

# ---- group: epw file
panel = Panel("http://climate.onebuilding.org/WMO_Region_5_Southwest_Pacific/IDN_Indonesia/JW_Jawa/IDN_JW_Bandung.967830_TMYx.zip")
epwmap = LBEPWmap(epw_map=Button())  # -> report; plug-in component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
downloadepw = LBDownloadWeather(weather_URL=panel)  # -> epw_file, stat_file, ddy_file; plug-in component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

# ---- group: epw file / Hour of the year
series = Series(Start="1", Step=1, Count="12")
series_2 = Series(Start="1", Step=1, Count="23")
hoy = LBCalculateHOY(month=series, hour=series_2)  # -> flatten(hoy), flatten(doy), flatten(date); plug-in component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

# ----
X_3 = UnitX(Factor="-350")
X_4 = UnitX(Factor="350")

# ---- group: Explode ground geometry
crv_10 = Curve(crv_9)
explode_2 = Explode(Curve=crv_10, Recursive=True)  # -> Segments, Vertices
pt_6 = Point(graft(explode_2.Vertices))
bang_6 = ExplodeTree(Data=pt_6)  # -> Branch0, Branch1, Branch2, Branch3, Branch4
pt_7 = Point(flatten(bang_6.Branch1))
pt_8 = Point(flatten(bang_6.Branch2))
pt_9 = Point(flatten(bang_6.Branch3))
pt_10 = Point(flatten(bang_6.Branch0))

# ---- group: Ground geometry points translation
vec_5 = VectorXYZ(XComponent=Slider(0, range=-10..10), YComponent=Slider(0, range=-10..10), ZComponent=0)  # -> Vector, Length
vec_6 = VectorXYZ(XComponent=Slider(0, range=-10..10), YComponent=Slider(0, range=-10..10), ZComponent=0)  # -> Vector, Length
vec_7 = VectorXYZ(XComponent=Slider(0, range=-10..10), YComponent=Slider(0, range=-10..10), ZComponent=0)  # -> Vector, Length
vec_8 = VectorXYZ(XComponent=Slider(0, range=-10..10), YComponent=Slider(0, range=-10..10), ZComponent=0)  # -> Vector, Length
move_14 = Move(Geometry=flatten(pt_10), Motion=vec_5.Vector)  # -> Geometry, Transform
move_15 = Move(Geometry=flatten(pt_7), Motion=vec_6.Vector)  # -> Geometry, Transform
move_16 = Move(Geometry=flatten(pt_8), Motion=vec_7.Vector)  # -> Geometry, Transform
move_17 = Move(Geometry=flatten(pt_9), Motion=vec_8.Vector)  # -> Geometry, Transform
pt_11 = Point(move_14.Geometry)
pt_12 = Point(move_15.Geometry)
pt_13 = Point(move_16.Geometry)
pt_14 = Point(move_17.Geometry)

# ---- group: Fillet
merge = Merge(Data1=pt_11, Data2=pt_12, Data3=pt_13, Data4=pt_14, Data5=pt_11)
pline_2 = PolyLine(Vertices=merge, Closed=False)
number_slider = Slider(0, range=0..15)
fillet = Fillet(Curve=pline_2, Radius=number_slider)

# ----
base_ground_floor_geometry = Curve(pline_2)
ground_floor_geometry = Curve(fillet)

# ---- group: Ground floor area
area_3 = Area(Geometry=ground_floor_geometry)  # -> Area, Centroid
panel_2 = Panel(area_3.Area)
expression_2 = Expression(x=panel_2, Expression="Format(\"{0:0.00}\",x)")

# ---- group: Building height
building_storey_2 = Number(building_storey)
floor_height_2 = Number(floor_height)
multiplication_2 = Multiplication(BuildingStorey=building_storey_2, FloorHeight=floor_height_2)
building_height = Number(multiplication_2)
panel_3 = Panel(building_height)

# ---- group: Roof geometry
building_height_2 = Number(panel_3)
ground_floor_geometry_2 = Curve(base_ground_floor_geometry)
Z_6 = UnitZ(Factor=building_height_2)
move_18 = Move(Geometry=ground_floor_geometry_2, Motion=Z_6)  # -> Geometry, Transform
pi_2 = Pi(Factor=1)
pln = Plane(area_3.Centroid)
multiplication_3 = Multiplication(A=Slider(0, range=-0.8..0.8), B=pi_2)
rotate_2 = Rotate(Geometry=move_18.Geometry, Angle=multiplication_3, Plane=pln)  # -> Geometry, Transform

# ---- group: Explode roof geometry
crv_11 = Curve(rotate_2.Geometry)
explode_3 = Explode(Curve=crv_11, Recursive=True)  # -> Segments, Vertices
pt_15 = Point(graft(explode_3.Vertices))
bang_7 = ExplodeTree(Data=pt_15)  # -> Branch0, Branch1, Branch2, Branch3, Branch4
pt_16 = Point(flatten(bang_7.Branch0))
pt_17 = Point(flatten(bang_7.Branch3))
pt_18 = Point(flatten(bang_7.Branch1))
pt_19 = Point(flatten(bang_7.Branch2))

# ----
Z_7 = UnitZ(Factor=0)

# ---- group: Expand
pt_20 = Point(pt_17)
pt_21 = Point(pt_16)
pt_22 = Point(pt_18)
pt_23 = Point(pt_19)
merge_2 = Merge(Data1=pt_21, Data2=pt_22, Data3=pt_23, Data4=pt_20, Data5=pt_21)
pline_3 = PolyLine(Vertices=merge_2, Closed=False)
pt_24 = Point(pt_20)
pt_25 = Point(pt_21)
pt_26 = Point(pt_23)
pt_27 = Point(pt_22)
vec_9 = VectorXYZ(XComponent=0, YComponent=north_horz, ZComponent=north_vert)  # -> Vector, Length
vec_10 = VectorXYZ(XComponent=0, YComponent=south_horz, ZComponent=south_vert)  # -> Vector, Length
move_19 = Move(Geometry=pt_25, Motion=vec_9.Vector)  # -> Geometry, Transform
move_20 = Move(Geometry=pt_27, Motion=vec_9.Vector)  # -> Geometry, Transform
move_21 = Move(Geometry=pt_26, Motion=vec_10.Vector)  # -> Geometry, Transform
move_22 = Move(Geometry=pt_24, Motion=vec_10.Vector)  # -> Geometry, Transform
vec_11 = VectorXYZ(XComponent=east_horz, YComponent=0, ZComponent=east_vert)  # -> Vector, Length
vec_12 = VectorXYZ(XComponent=west_horz, YComponent=0, ZComponent=west_vert)  # -> Vector, Length
move_23 = Move(Geometry=move_19.Geometry, Motion=vec_12.Vector)  # -> Geometry, Transform
move_24 = Move(Geometry=move_20.Geometry, Motion=vec_11.Vector)  # -> Geometry, Transform
move_25 = Move(Geometry=move_21.Geometry, Motion=vec_11.Vector)  # -> Geometry, Transform
move_26 = Move(Geometry=move_22.Geometry, Motion=vec_12.Vector)  # -> Geometry, Transform
move_27 = Move(Geometry=[move_23.Geometry, move_26.Geometry], Motion=Z_7)  # -> graft(Geometry), Transform
move_28 = Move(Geometry=[move_23.Geometry, move_24.Geometry], Motion=Z_7)  # -> graft(Geometry), Transform
move_29 = Move(Geometry=[move_24.Geometry, move_25.Geometry], Motion=Z_7)  # -> graft(Geometry), Transform
move_30 = Move(Geometry=[move_25.Geometry, move_26.Geometry], Motion=Z_7)  # -> graft(Geometry), Transform
bang_8 = ExplodeTree(Data=move_27.Geometry)  # -> flatten(Branch0), Branch1
bang_9 = ExplodeTree(Data=move_28.Geometry)  # -> Branch0, flatten(Branch1)
bang_10 = ExplodeTree(Data=move_29.Geometry)  # -> Branch0, flatten(Branch1)
bang_11 = ExplodeTree(Data=move_30.Geometry)  # -> Branch0, flatten(Branch1)
ln = Line(StartPoint=bang_9.Branch0, EndPoint=bang_9.Branch1)
ln_2 = Line(StartPoint=bang_11.Branch0, EndPoint=bang_11.Branch1)
ln_3 = Line(StartPoint=bang_8.Branch0, EndPoint=bang_8.Branch1)
ln_4 = Line(StartPoint=bang_10.Branch0, EndPoint=bang_10.Branch1)
pline_4 = PolyLine(Vertices=[bang_8.Branch0, bang_9.Branch1, bang_10.Branch1, bang_11.Branch1], Closed=True)
crv_12 = Curve(pline_4)

# ---- group: Explode roof geometry
crv_13 = Curve(crv_12)
explode_4 = Explode(Curve=crv_13, Recursive=True)  # -> Segments, Vertices
pt_28 = Point(graft(explode_4.Vertices))
bang_12 = ExplodeTree(Data=pt_28)  # -> Branch0, Branch1, Branch2, Branch3, Branch4
pt_29 = Point(flatten(bang_12.Branch0))
pt_30 = Point(flatten(bang_12.Branch1))
pt_31 = Point(flatten(bang_12.Branch2))
pt_32 = Point(flatten(bang_12.Branch3))

# ---- group: Roof geometry
pt_33 = Point(pt_29)
pt_34 = Point(pt_30)
pt_35 = Point(pt_31)
pt_36 = Point(pt_32)
Z_8 = UnitZ(Factor=0)
move_31 = Move(Geometry=pt_33, Motion=Z_8)  # -> Geometry, Transform
move_32 = Move(Geometry=pt_34, Motion=Z_8)  # -> Geometry, Transform
move_33 = Move(Geometry=pt_35, Motion=Z_8)  # -> Geometry, Transform
move_34 = Move(Geometry=pt_36, Motion=Z_8)  # -> Geometry, Transform
move_35 = Move(Geometry=move_31.Geometry, Motion=vec.Vector)  # -> Geometry, Transform
move_36 = Move(Geometry=move_32.Geometry, Motion=vec_2.Vector)  # -> Geometry, Transform
move_37 = Move(Geometry=move_33.Geometry, Motion=vec_3.Vector)  # -> Geometry, Transform
move_38 = Move(Geometry=move_34.Geometry, Motion=vec_4.Vector)  # -> Geometry, Transform
merge_3 = Merge(Data1=move_35.Geometry, Data2=move_36.Geometry, Data3=move_37.Geometry, Data4=move_38.Geometry, Data5=move_35.Geometry)
pline_5 = PolyLine(Vertices=merge_3, Closed=False)

# ----
fillet_2 = Fillet(Curve=pline_5, Radius=number_slider)

# ---- group: Building mass
roof = Curve(fillet_2)
ground_floor = Curve(ground_floor_geometry)
patch = Patch(Curves=roof, Spans=20, Flexibility=1, Trim=True)
loft = Loft(
    Curves=[ground_floor, roof],
    Options={Adjust=False, Closed=False, LoftEnds=0, LoftSimp=0, LoftType=0, Rebuild=10, Refit=0.01})
preview_6 = CustomPreview(Geometry=[patch, loft], Material=ColourSwatch(SwatchColor=RGB(194, 251, 255)))

# ---- group: Luas
ground_floor_area_sqm = Panel(expression_2)

# ----
division = Division(A=ground_floor_area_sqm, B=site_area_sqm)
multiplication_4 = Multiplication(A=division, B=100)
expression_3 = Expression(x=multiplication_4, Expression="Format(\"{0:0.00}\",x)")
building_covered_ratio = Panel(expression_3)

# ---- group: Solar Radiation
importepw = LBImportEPW(epw_file=downloadepw.epw_file)  # -> location, dry_bulb_temperature, dew_point_temperature, relative_humidity, wind_speed, wind_direction, direct_normal_rad, diffuse_horizontal_rad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; plug-in component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
skymatrix = LBCumulativeSkyMatrix(
    location=importepw.location,
    direct_rad=importepw.direct_normal_rad,
    diffuse_rad=importepw.diffuse_horizontal_rad,
    hoys=hoy.hoy)  # -> report, sky_mtx; plug-in component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
solar_radiation_analysis = BooleanToggle(False)
skydome = LBSkyDome(sky_mtx=skymatrix.sky_mtx)  # -> report, mesh, compass, legend, title, patch_vecs, patch_values, mesh_values; plug-in component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

# ---- group: Sun Hours
importloc = LBImportLocation(epw_file=downloadepw.epw_file)  # -> location; plug-in component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
sunpath = LBSunPath(north="0", location=importloc, hoys=hoy.hoy, scale="2")  # -> report, vectors, altitudes, azimuths, hoys, sun_pts, analemma, daily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; plug-in component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
pt_37 = Point(sunpath.sun_pts)
sun_hours_analysis = BooleanToggle(False)

# ---- group: Floors
floor_height_3 = Number(floor_height)
building_mass = Brep(loft)
contour = Contour(Shape=building_mass, Point=Point(0, 0, 0), Direction=Vector(0, 0, 1), Distance=floor_height_3)  # -> flatten(Contours)
area_4 = Area(Geometry=contour)  # -> Area, Centroid
ma = MassAddition(Input=area_4.Area)  # -> Result, PartialResults
panel_4 = Panel(area_4.Area)

# ---- group: epw file / All geometry
brep = Brep([building_mass, move.Geometry, extr, extr_2, extr_3, srf_6])

# ----
move_39 = Move(Geometry=brep, Motion=X_4)  # -> Geometry, Transform
move_40 = Move(Geometry=brep, Motion=X_3)  # -> Geometry, Transform

# ---- group: Solar Radiation (continued)
incidentradiation = LBIncidentRadiation(
    sky_mtx=skymatrix.sky_mtx,
    geometry=flatten(move_39.Geometry),
    grid_size="20",
    offset_dist="0.01",
    run=solar_radiation_analysis)  # -> report, points, results, total, mesh, legend, title, int_mtx; plug-in component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

# ---- group: Sun Hours (continued)
directsunhours = LBDirectSunHours(vectors=flatten(sunpath.vectors), geometry=flatten(move_40.Geometry), grid_size="5", run=sun_hours_analysis)  # -> report, points, results, mesh, legend, title, int_mtx; plug-in component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

# ----
total_area = Number(ma.Result)

pipe = Pipe(Curve=contour, Radius=0.2, Caps=0)  # disabled
preview_7 = CustomPreview(Geometry=pipe, Material=ColourSwatch(SwatchColor=RGB(0, 85, 128)))

expression_4 = Expression(x=total_area, Expression="Format(\"{0:0.00}\",x)")

# ---- group: Floors (continued)
panel_5 = Panel(total_area)

# ----
expression_5 = Expression(x=area_4.Area, Expression="Format(\"{0:0.00}\",x)")

# ---- group: Luas (continued)
building_area_sqm = Panel(expression_4)
num = Number(building_area_sqm)
each_floor_area_sqm = Panel(expression_5)

# ----
division_2 = Division(A=building_area_sqm, B=site_area_sqm)
expression_6 = Expression(x=division_2, Expression="Format(\"{0:0.00}\",x)")
floor_area_ratio = Panel(expression_6)
