# Grasshopper definition form_generator_02.gh (Grasshopper 1.0.7)

# ---- group: Ground floor geometry
crv = Curve(<curve referenced from the Rhino model>)
explode = Explode(Curve=crv, Recursive=True)  # -> Segments, Vertices
pt = Point(explode.Vertices)
graft = GraftTree(Tree=pt, IncludeEmptyLists=True, IncludeNullItems=True)
bang = ExplodeTree(Data=graft)  # -> Branch0, Branch1, Branch2, Branch3, Branch4
pt_2 = Point(bang.Branch0)
pt_3 = Point(bang.Branch1)
pt_4 = Point(bang.Branch2)
pt_5 = Point(bang.Branch3)
pt_6 = Point(pt_2)
flatten = FlattenTree(Tree=pt_2, Path="{0}")
flatten_2 = FlattenTree(Tree=pt_4, Path="{0}")
flatten_3 = FlattenTree(Tree=pt_6, Path="{0}")
flatten_4 = FlattenTree(Tree=pt_3, Path="{0}")
flatten_5 = FlattenTree(Tree=pt_5, Path="{0}")
merge = Merge(Data1=flatten, Data2=flatten_4, Data3=flatten_2, Data4=flatten_5, Data5=flatten_3)
pline = PolyLine(Vertices=merge, Closed=False)

# ----
vec = VectorXYZ(XComponent=Slider(0, range=-20..20), YComponent=Slider(0, range=-20..20), ZComponent=Slider(0, range=-20..20))  # -> Vector, Length
vec_2 = VectorXYZ(XComponent=Slider(0, range=-20..20), YComponent=Slider(0, range=-20..20), ZComponent=Slider(0, range=-20..20))  # -> Vector, Length
vec_3 = VectorXYZ(XComponent=Slider(0, range=-20..20), YComponent=Slider(0, range=-20..20), ZComponent=Slider(0, range=-20..20))  # -> Vector, Length
vec_4 = VectorXYZ(XComponent=Slider(0, range=-20..20), YComponent=Slider(0, range=-20..20), ZComponent=Slider(0, range=-20..20))  # -> Vector, Length

# ---- group: Transformation rules
ground_floor_rotate_angle = Slider(0, range=-2..2)
ground_floor_scale_factor = Slider(1, range=0.5..1.5)
roof_rotate_angle = Slider(0, range=-2..2)
roof_scale_factor = Slider(1, range=0.5..1.5)

# ---- group: Genes
building_storey = Slider(25, range=20..30)
floor_height = Slider(5, range=4..6)
ground_floor_geometry = Curve(pline)

# ---- group: Gorund floor center point
ground_floor_geometry_2 = Curve(ground_floor_geometry)
topoly = CurveToPolyline(Curve=ground_floor_geometry_2, ToleranceDistance=0, ToleranceAngle=0)  # -> Polyline, Segments
pcen = PolygonCenter(Polyline=topoly.Polyline)  # -> CenterV, CenterE, CenterA
gf_center_point = Point(pcen.CenterV)

# ---- group: Building height
building_storey_2 = Number(building_storey)
floor_height_2 = Number(floor_height)
multiplication = Multiplication(BuildingStorey=building_storey_2, FloorHeight=floor_height_2)
building_height = Number(multiplication)
panel = Panel(building_height)

# ---- group: Roof geometry
building_height_2 = Number(panel)
pt_7 = Point(flatten)
pt_8 = Point(flatten_4)
pt_9 = Point(flatten_2)
pt_10 = Point(flatten_5)
Z = UnitZ(Factor=building_height_2)
Z_2 = UnitZ(Factor=building_height_2)
Z_3 = UnitZ(Factor=building_height_2)
Z_4 = UnitZ(Factor=building_height_2)
move = Move(Geometry=pt_7, Motion=Z)  # -> Geometry, Transform
move_2 = Move(Geometry=pt_8, Motion=Z_2)  # -> Geometry, Transform
move_3 = Move(Geometry=pt_9, Motion=Z_3)  # -> Geometry, Transform
move_4 = Move(Geometry=pt_10, Motion=Z_4)  # -> Geometry, Transform
move_5 = Move(Geometry=move.Geometry, Motion=vec.Vector)  # -> Geometry, Transform
move_6 = Move(Geometry=move_2.Geometry, Motion=vec_2.Vector)  # -> Geometry, Transform
move_7 = Move(Geometry=move_3.Geometry, Motion=vec_3.Vector)  # -> Geometry, Transform
move_8 = Move(Geometry=move_4.Geometry, Motion=vec_4.Vector)  # -> Geometry, Transform
merge_2 = Merge(Data1=move_5.Geometry, Data2=move_6.Geometry, Data3=move_7.Geometry, Data4=move_8.Geometry, Data5=move_5.Geometry)
pline_2 = PolyLine(Vertices=merge_2, Closed=False)

# ----
buliding_height = Number(panel)
_2 = Number(2)
ground_floor_geometry_3 = Curve(ground_floor_geometry)
division = Division(A=buliding_height, B=_2)
scale = Slider(1, range=0.5..1.5)
vec_5 = VectorXYZ(XComponent=Slider(0, range=-20..20), YComponent=Slider(0, range=-20..20), ZComponent=division)  # -> Vector, Length
move_9 = Move(Geometry=ground_floor_geometry_3, Motion=vec_5.Vector)  # -> Geometry, Transform
scale_2 = Scale(Geometry=move_9.Geometry, Center=Point(0, 0, 0), Factor=scale)  # -> Geometry, Transform

# ---- group: Ground floor geometry scale
gf_center_point_2 = Point(gf_center_point)
ground_floor_scale_factor_2 = Number(ground_floor_scale_factor)
gf_geometry = Curve(ground_floor_geometry)
scale_3 = Scale(Geometry=gf_geometry, Center=gf_center_point_2, Factor=ground_floor_scale_factor_2)  # -> Geometry, Transform

# ---- group: Roof center point
building_height_3 = Number(panel)
gf_center_point_3 = Point(gf_center_point)
Z_5 = UnitZ(Factor=building_height_3)
move_10 = Move(Geometry=gf_center_point_3, Motion=Z_5)  # -> Geometry, Transform

# ---- group: Roof geometry scale
roof_center_point = Point(move_10.Geometry)
roof_scale_factor_2 = Number(roof_scale_factor)
roof_geometry = Curve(pline_2)
scale_4 = Scale(Geometry=roof_geometry, Center=roof_center_point, Factor=roof_scale_factor_2)  # -> Geometry, Transform

# ---- group: Roof geometry
building_height_4 = Number(panel)
ground_floor_geometry_4 = Curve(ground_floor_geometry)
Z_6 = UnitZ(Factor=building_height_4)
move_11 = Move(Geometry=ground_floor_geometry_4, Motion=Z_6)  # -> Geometry, Transform

# ----
crv_2 = Curve(scale_2.Geometry)

# ---- group: Roof geometry rotate
roof_rotate_angle_2 = Number(roof_rotate_angle)
roof_plane = Plane(move_10.Geometry)
rotate = Rotate(Geometry=scale_4.Geometry, Angle=roof_rotate_angle_2, Plane=roof_plane)  # -> Geometry, Transform

# ---- group: Ground floor geometry rotate
gf_center_point_4 = Point(gf_center_point)
gf_rotate_angle = Number(ground_floor_rotate_angle)
rotate_2 = Rotate(Geometry=scale_3.Geometry, Angle=gf_rotate_angle, Plane=gf_center_point_4)  # -> Geometry, Transform

# ----
roof_rotate_angle_3 = Slider(0, range=-1..1)
yz = YZPlane(Origin=move_10.Geometry)
rotate_3 = Rotate(Geometry=rotate.Geometry, Angle=roof_rotate_angle_3, Plane=yz)  # -> Geometry, Transform
roof_rotate_angle_4 = Slider(0, range=-1..1)
xz = XZPlane(Origin=move_10.Geometry)
rotate_4 = Rotate(Geometry=rotate_3.Geometry, Angle=roof_rotate_angle_4, Plane=xz)  # -> Geometry, Transform

middle_floor = Curve(crv_2)

# ---- group: Building mass
ground_floor = Curve(rotate_2.Geometry)
roof = Curve(rotate_4.Geometry)
loft = Loft(
    Curves=[ground_floor, middle_floor, roof],
    Options={Adjust=False, Closed=False, LoftEnds=0, LoftSimp=0, LoftType=0, Rebuild=10, Refit=0.01})
srf = Surface(roof)
srf_2 = Surface(ground_floor)
preview = CustomPreview(Geometry=[loft, srf_2, srf], Material=ColourSwatch(SwatchColor=RGB(176, 255, 229)))

# ---- group: Ground floor area
ground_floor_geometry_5 = Curve(ground_floor_geometry)
area = Area(Geometry=ground_floor_geometry_5)  # -> BuildingArea, Centroid

# ----
building_area = Number(area.BuildingArea)

# ---- group: Ground floor area (continued)
panel_2 = Panel(building_area)

# ---- group: Floors
building_mass = Brep(loft)
floor_height_3 = Number(floor_height)
contour = Contour(Shape=building_mass, Point=Point(0, 0, 0), Direction=Vector(0, 0, 1), Distance=floor_height_3)  # -> flatten(Contours)
area_2 = Area(Geometry=contour)  # -> Area, Centroid
ma = MassAddition(Input=area_2.Area)  # -> Result, PartialResults
panel_3 = Panel(area_2.Area)

# ----
total_area = Number(ma.Result)

total_area_2 = Number(total_area)
int = Integer(total_area_2)
panel_4 = Panel(int)

# ---- group: Floors (continued)
panel_5 = Panel(total_area)
