# Grasshopper definition geo_reconstruct.gh (Grasshopper 1.0.7)

crv = Curve(<curve referenced from the Rhino model>)
explode = Explode(Curve=crv, Recursive=True)  # -> Segments, Vertices
pt = Point(explode.Vertices)
graft = GraftTree(Tree=pt, IncludeEmptyLists=True, IncludeNullItems=True)
bang = ExplodeTree(Data=graft)  # -> Branch0, Branch1, Branch2, Branch3, Branch4
pt_2 = Point(flatten(bang.Branch0))
pt_3 = Point(flatten(bang.Branch1))
pt_4 = Point(flatten(bang.Branch2))
pt_5 = Point(flatten(bang.Branch3))
pt_6 = Point(pt_2)
nurbs = NurbsCurve(Vertices=[pt_2, pt_3, pt_4, pt_5, pt_6], Degree=Slider(1, range=1..3), Periodic=False)  # -> Curve, Length, Domain
