# Grasshopper definition mass-manipulator.gh (Grasshopper 1.0.8)

# ---- group: Ground Points
X = UnitX(Factor=Slider(40, range=0..100))
Y = UnitY(Factor=Slider(40, range=0..100))
pt = ConstructPoint(XCoordinate=Slider(0, range=-100..100), YCoordinate=Slider(0, range=-100..100), ZCoordinate=0)
move = Move(Geometry=pt, Motion=X)  # -> Geometry, Transform
move_2 = Move(Geometry=move.Geometry, Motion=Y)  # -> Geometry, Transform
move_3 = Move(Geometry=pt, Motion=Y)  # -> Geometry, Transform
pt_2 = Point(pt)
pt_3 = Point(move.Geometry)
pt_4 = Point(move_2.Geometry)
pt_5 = Point(move_3.Geometry)

# ---- group: Ground Shape Rotation
ln = Line(StartPoint=pt_2, EndPoint=pt_3)
ln_2 = Line(StartPoint=pt_4, EndPoint=pt_5)
ln_3 = Line(StartPoint=pt_3, EndPoint=pt_4)
ln_4 = Line(StartPoint=pt_5, EndPoint=pt_2)
merge = Merge(Data1=ln, Data2=ln_3, Data3=ln_2, Data4=ln_4)
join = JoinCurves(Curves=merge, Preserve=False)
area = Area(Geometry=join)  # -> Area, Centroid
rad = Radians(Degrees=Slider(0, range=0..360))
rotate = Rotate(Geometry=join, Angle=rad, Plane=area.Centroid)  # -> Geometry, Transform

# ---- group: Ground Lines Translation
explode = Explode(Curve=rotate.Geometry, Recursive=True)  # -> Segments, Vertices
pt_6 = Point(explode.Vertices)
bang = ExplodeTree(Data=graft(pt_6))  # -> _0000, _0001, _0002, _0003, _0004
pt_7 = Point(bang._0001)
pt_8 = Point(bang._0004)
pt_9 = Point(bang._0003)
pt_10 = Point(bang._0002)
Y_2 = UnitY(Factor=Slider(0, range=-50..50))
Y_3 = UnitY(Factor=Slider(0, range=-50..50))
move_4 = Move(Geometry=pt_10, Motion=Y_2)  # -> Geometry, Transform
move_5 = Move(Geometry=pt_9, Motion=Y_3)  # -> Geometry, Transform
move_6 = Move(Geometry=pt_7, Motion=Y_2)  # -> Geometry, Transform
move_7 = Move(Geometry=pt_8, Motion=Y_3)  # -> Geometry, Transform
pt_11 = Point(move_5.Geometry)
pt_12 = Point(move_6.Geometry)
pt_13 = Point(move_7.Geometry)
pt_14 = Point(move_4.Geometry)
X_2 = UnitX(Factor=Slider(0, range=-50..50))
X_3 = UnitX(Factor=Slider(0, range=-50..50))
move_8 = Move(Geometry=pt_14, Motion=X_3)  # -> Geometry, Transform
move_9 = Move(Geometry=pt_11, Motion=X_3)  # -> Geometry, Transform
move_10 = Move(Geometry=pt_12, Motion=X_2)  # -> Geometry, Transform
move_11 = Move(Geometry=pt_13, Motion=X_2)  # -> Geometry, Transform

# ---- group: Ground Points Translation
number_slider = Slider(0, range=-50..50)
number_slider_2 = Slider(0, range=-50..50)
number_slider_3 = Slider(0, range=-50..50)
number_slider_4 = Slider(0, range=-50..50)

# ----
vec = VectorXYZ(XComponent=number_slider_3, YComponent=Slider(0, range=-50..50), ZComponent=0)  # -> Vector, Length
vec_2 = VectorXYZ(XComponent=number_slider_2, YComponent=Slider(0, range=-50..50), ZComponent=0)  # -> Vector, Length
vec_3 = VectorXYZ(XComponent=number_slider_4, YComponent=Slider(0, range=-50..50), ZComponent=0)  # -> Vector, Length
vec_4 = VectorXYZ(XComponent=number_slider, YComponent=Slider(0, range=-50..50), ZComponent=0)  # -> Vector, Length

# ---- group: Ground Points Translation (continued)
move_12 = Move(Geometry=move_10.Geometry, Motion=vec_4.Vector)  # -> Geometry, Transform
move_13 = Move(Geometry=move_8.Geometry, Motion=vec_2.Vector)  # -> Geometry, Transform
move_14 = Move(Geometry=move_9.Geometry, Motion=vec.Vector)  # -> Geometry, Transform
move_15 = Move(Geometry=move_11.Geometry, Motion=vec_3.Vector)  # -> Geometry, Transform

# ---- group: Ground Final Shape
merge_2 = Merge(Data1=move_12.Geometry, Data2=move_13.Geometry, Data3=move_14.Geometry, Data4=move_15.Geometry)  # -> flatten(Result)
pline = PolyLine(Vertices=merge_2, Closed=Toggle(True))
area_2 = Area(Geometry=pline)  # -> Area, Centroid

# ---- group: Ground Shape Scale and Fillet
scale = Scale(Geometry=pline, Center=area_2.Centroid, Factor=Slider(1, range=0.1..2))  # -> Geometry, Transform
number_slider_5 = Slider(0, range=0..50)
fillet = Fillet(Curve=scale.Geometry, Radius=number_slider_5)

# ---- group: Roof Points
crv = Curve(pline)
number_slider_6 = Slider(4, range=0..10)
multiplication = Multiplication(A=number_slider_6, B=Slider(30, range=0..50))
Z = UnitZ(Factor=multiplication)
move_16 = Move(Geometry=crv, Motion=Z)  # -> Geometry, Transform
explode_2 = Explode(Curve=move_16.Geometry, Recursive=True)  # -> Segments, Vertices
pt_15 = Point(explode_2.Vertices)
bang_2 = ExplodeTree(Data=graft(pt_15))  # -> Branch0, Branch1, Branch2, Branch3, Branch4

# ---- group: Roof Shape Rotation
pt_16 = Point(bang_2.Branch1)
pt_17 = Point(bang_2.Branch0)
pt_18 = Point(bang_2.Branch2)
pt_19 = Point(bang_2.Branch3)
ln_5 = Line(StartPoint=pt_17, EndPoint=pt_16)
ln_6 = Line(StartPoint=pt_18, EndPoint=pt_19)
ln_7 = Line(StartPoint=pt_16, EndPoint=pt_18)
ln_8 = Line(StartPoint=pt_19, EndPoint=pt_17)
merge_3 = Merge(Data1=ln_5, Data2=ln_7, Data3=ln_6, Data4=ln_8)  # -> flatten(Result)
join_2 = JoinCurves(Curves=merge_3, Preserve=False)
area_3 = Area(Geometry=join_2)  # -> Area, Centroid
rad_2 = Radians(Degrees=Slider(0, range=0..360))
rotate_2 = Rotate(Geometry=join_2, Angle=rad_2, Plane=area_3.Centroid)  # -> Geometry, Transform

# ---- group: Roof Lines Translation
explode_3 = Explode(Curve=rotate_2.Geometry, Recursive=True)  # -> Segments, Vertices
pt_20 = Point(explode_3.Vertices)
bang_3 = ExplodeTree(Data=graft(pt_20))  # -> _0000, _0001, _0002, _0003, _0004
pt_21 = Point(bang_3._0001)
pt_22 = Point(bang_3._0004)
pt_23 = Point(bang_3._0003)
pt_24 = Point(bang_3._0002)
number_slider_7 = Slider(0, range=-50..50)
number_slider_8 = Slider(0, range=-50..50)
number_slider_9 = Slider(0, range=-50..50)
number_slider_10 = Slider(0, range=-50..50)

# ----
vec_5 = VectorXYZ(XComponent=0, YComponent=number_slider_8, ZComponent=Slider(0, range=-50..50))  # -> Vector, Length
vec_6 = VectorXYZ(XComponent=0, YComponent=number_slider_7, ZComponent=Slider(0, range=-50..50))  # -> Vector, Length
vec_7 = VectorXYZ(XComponent=number_slider_9, YComponent=0, ZComponent=Slider(0, range=-50..50))  # -> Vector, Length
vec_8 = VectorXYZ(XComponent=number_slider_10, YComponent=0, ZComponent=Slider(0, range=-50..50))  # -> Vector, Length

# ---- group: Roof Lines Translation (continued)
move_17 = Move(Geometry=pt_24, Motion=vec_6.Vector)  # -> Geometry, Transform
move_18 = Move(Geometry=pt_23, Motion=vec_5.Vector)  # -> Geometry, Transform
move_19 = Move(Geometry=pt_21, Motion=vec_6.Vector)  # -> Geometry, Transform
move_20 = Move(Geometry=pt_22, Motion=vec_5.Vector)  # -> Geometry, Transform
pt_25 = Point(move_18.Geometry)
pt_26 = Point(move_19.Geometry)
pt_27 = Point(move_20.Geometry)
pt_28 = Point(move_17.Geometry)
move_21 = Move(Geometry=pt_28, Motion=vec_7.Vector)  # -> Geometry, Transform
move_22 = Move(Geometry=pt_25, Motion=vec_7.Vector)  # -> Geometry, Transform
move_23 = Move(Geometry=pt_26, Motion=vec_8.Vector)  # -> Geometry, Transform
move_24 = Move(Geometry=pt_27, Motion=vec_8.Vector)  # -> Geometry, Transform

# ---- group: Roof Points Translation
number_slider_11 = Slider(0, range=-50..50)
number_slider_12 = Slider(0, range=-50..50)
number_slider_13 = Slider(0, range=-50..50)
number_slider_14 = Slider(0, range=-50..50)
number_slider_15 = Slider(0, range=-50..50)
number_slider_16 = Slider(0, range=-50..50)
number_slider_17 = Slider(0, range=-50..50)
number_slider_18 = Slider(0, range=-50..50)

# ----
vec_9 = VectorXYZ(XComponent=number_slider_15, YComponent=Slider(0, range=-50..50), ZComponent=number_slider_16)  # -> Vector, Length
vec_10 = VectorXYZ(XComponent=number_slider_14, YComponent=Slider(0, range=-50..50), ZComponent=number_slider_11)  # -> Vector, Length
vec_11 = VectorXYZ(XComponent=number_slider_18, YComponent=Slider(0, range=-50..50), ZComponent=number_slider_17)  # -> Vector, Length
vec_12 = VectorXYZ(XComponent=number_slider_12, YComponent=Slider(0, range=-50..50), ZComponent=number_slider_13)  # -> Vector, Length

# ---- group: Roof Points Translation (continued)
move_25 = Move(Geometry=move_23.Geometry, Motion=vec_12.Vector)  # -> Geometry, Transform
move_26 = Move(Geometry=move_21.Geometry, Motion=vec_10.Vector)  # -> Geometry, Transform
move_27 = Move(Geometry=move_22.Geometry, Motion=vec_9.Vector)  # -> Geometry, Transform
move_28 = Move(Geometry=move_24.Geometry, Motion=vec_11.Vector)  # -> Geometry, Transform

# ---- group: Ground Final Shape
merge_4 = Merge(Data1=move_25.Geometry, Data2=move_26.Geometry, Data3=move_27.Geometry, Data4=move_28.Geometry)  # -> flatten(Result)
pline_2 = PolyLine(Vertices=merge_4, Closed=Toggle(True))

# ---- group: Roof Shape Scale and Fillet
merge_5 = Merge(Data1=move_23.Geometry, Data2=move_21.Geometry, Data3=move_22.Geometry, Data4=move_24.Geometry)  # -> flatten(Result)
pline_3 = PolyLine(Vertices=merge_5, Closed=Toggle(True))
area_4 = Area(Geometry=pline_3)  # -> Area, Centroid
scale_2 = Scale(Geometry=pline_2, Center=area_4.Centroid, Factor=Slider(1, range=0.1..2))  # -> Geometry, Transform
fillet_2 = Fillet(Curve=scale_2.Geometry, Radius=number_slider_5)
patch = Patch(Curves=fillet_2, Spans=20, Flexibility=1, Trim=True)

# ----
merge_6 = Merge(Data1=fillet, Data2=fillet_2)
crv_2 = Curve(merge_6)
loft = Loft(Curves=crv_2, Options={Adjust=False, Closed=False, LoftEnds=0, LoftSimp=0, LoftType=0, Rebuild=10, Refit=0.01})
cap = CapHoles(Brep=loft)
contour = Contour(Shape=cap, Point=area_2.Centroid, Direction=Vector(0, 0, 1), Distance=number_slider_6)

preview = CustomPreview(Geometry=[cap, patch], Material=ColourSwatch(SwatchColor=RGB(178, 255, 255)))
